# Grasshopper definition pill.gh (Grasshopper 1.0.7)
# plug-ins: Discover

number_slider = Slider(36, range=0..100)
button = Button()
sequence = Sequence(Number=4, Message=number_slider)  # -> Status, Values
continuous = Continuous(Range=Domain(0, 1), Count=10, Message=number_slider)  # -> Status, Values
categorical = Categorical(Number=4, Count=10, Message=number_slider)  # -> Status, Values
panel = Panel(sequence.Values)
panel_2 = Panel(sequence.Status)
panel_3 = Panel(categorical.Values)
panel_4 = Panel(categorical.Status)
panel_5 = Panel(continuous.Values)
panel_6 = Panel(continuous.Status)
geo = Geometry(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)
cp = ControlPoints(Curve=geo)  # -> Points, Weights, Knots
split = SplitList(List=cp.Points, Index=Slider(1, range=0..1))  # -> ListA, ListB
split_2 = SplitList(List=split.ListB, Index=Slider(3, range=0..10))  # -> ListA, ListB
end = EndPoints(Curve=geo)  # -> Start, End
ln = Line(StartPoint=end.Start, EndPoint=end.End)

# ---- group: Discover
panel_7 = Panel("Surface Area")
panel_8 = Panel("Volume")

button_2 = Button()
panel_9 = Panel("5")
panel_10 = Panel("3")

# ----
discover = Discover(Connect=button_2)  # -> Status, Message
continuous_2 = Continuous(Range=panel_9, Count=panel_10, Message=discover.Message)  # -> Status, Values
c_script = CSharpScript(x=discover.Message)  # -> out, A
# ---------- c_script: C# ----------
    Print("Message received at [" + DateTime.Now.ToString() + "] " + x);
# ---------- end c_script ----------

# ---- group: Discover (continued)
continuous_3 = Continuous(Range=panel_9, Count=panel_10, Message=discover.Message)  # -> Status, Values
screenshot = CaptureScreenshot(ViewName="Perspective", Message=discover.Message)

# ----
panel_11 = Panel(c_script.out)
bang = ExplodeTree(Data=simplify(graft(continuous_3.Values)))  # -> Branch0, Branch1, Branch2
X = UnitX(Factor=bang.Branch0)
X_2 = UnitX(Factor=bang.Branch1)
X_3 = UnitX(Factor=bang.Branch2)
move = Move(Geometry=split.ListA, Motion=X)  # -> Geometry, Transform
move_2 = Move(Geometry=split_2.ListA, Motion=X_2)  # -> Geometry, Transform
move_3 = Move(Geometry=split_2.ListB, Motion=X_3)  # -> Geometry, Transform
merge = Merge(Data1=flatten(move.Geometry), Data2=flatten(move_2.Geometry), Data3=flatten(move_3.Geometry))
nurbcrv = NurbsCurve(Points=merge, Weights=cp.Weights, Knots=cp.Knots)  # -> Curve, Length, Domain
revsrf = Revolution(Curve=nurbcrv.Curve, Axis=ln, Domain=Domain(0, 6.283185307))
cap = CapHoles(Brep=revsrf)
volume = Volume(Geometry=cap)  # -> Volume, Centroid
area = Area(Geometry=cap)  # -> Area, Centroid
objective = Objective(Name=panel_7, Value=area.Area, Goal="Minimize")
objective_2 = Objective(Name=panel_8, Value=volume.Volume, Goal="Maximize")
