# Grasshopper definition test.gh (Grasshopper 1.0.7)
# plug-ins: Discover

discover = Discover(Connect=Button())  # -> Status, Active
panel = Panel(discover.Active)
c_script = CSharpScript(x=discover.Active)  # -> out, A
# ---------- c_script: C# ----------
    Print("Message received at [" + DateTime.Now.ToString() + "] " + x);
# ---------- end c_script ----------
panel_2 = Panel(c_script.out)
