# Grasshopper definition test2.gh (Grasshopper 1.0.7)

c_script = CSharpScript(x=Button())  # -> out, A; inputs x: Boolean
# ---------- c_script: C# ----------
    access.DisableGapLogic();
    
    if (x){

      //connect

      //waiting = true;
      //dt = DateTime.Now;
      
      

      //A = "200";

    }else{
      
      
      //if (waiting){
        
        //TimeSpan ts = DateTime.Now - dt;
        
        //if ts.TotalSeconds < 
        
      //  waiting = false;
        
        
        
        
      //}

      A = "200";

    }
# ---------- c_script: C# additional code ----------
  private bool waiting = false;
  private DateTime dt = DateTime.Now;

  //protected override void ExpireDownStreamObjects()
  //{
  //  if (UpdateOutput)
  //    Params.Output[0].ExpireSolution(false);
  //}
# ---------- end c_script ----------
c_script_2 = CSharpScript(x=c_script.A)  # -> out, A
# ---------- c_script_2: C# ----------
    Print("Message received at [" + DateTime.Now.ToString() + "] " + x);
# ---------- end c_script_2 ----------
panel = Panel(c_script.out)
panel_2 = Panel(c_script_2.out)
